# Grasshopper definition group4.gh (Grasshopper 0.9.76)
# plug-ins: MeshEdit Components, LunchBox, Weaverbird, Firefly.Core

# ----
# Grasshopper triggered by Light
# 
#   Create a physical model of a crystal made of laser-cut thick paper, which geometry was also modeled parametrically using Grasshopper 3D.
#   At 4 faces of the crystal, were installed 4 photoresistors that read the amount of light through an Arduino <https://www.arduino.cc/>. Grasshopper receives this value through the Firefly pluggin  <http://www.fireflyexperiments.com/>, which translates through the code to colors at a virtual model of the same physical crystal model.
#   Concept of project done by Itay Stoler under the tuition of Orion Campos, at the Kinetic Structures Workshop, Bezalel Academy of Arts and Design, Department of Architecture.Jerusalem, January 7th to 14th, 2018
# 
#   Input:
#   4x Photo cell (CdS photoresistor)
#   4x 10KΩ resistor
# 
#   created January 10th, 2018
#   by Orion Campos <www.orioncampos.com> <https://github.com/orion-campos>
ports_available = COMPortsAvailable()
toggle = BooleanToggle(True)
timer = Timer(TimerInterval=200, Target=[uno_read, read])
panel = Panel(ports_available)
read = SerialReadGeneric(StartReadingValues=toggle, PortNumber=ports_available)  # -> SerialOutput, StatusMessage
uno_read = UnoRead(StartReadingValues=Toggle(False), PortNumber=ports_available)  # -> AnalogPin0, AnalogPin1, AnalogPin2, AnalogPin3, AnalogPin4, AnalogPin5, DigitalPin2, DigitalPin4, DigitalPin7, StatusMessage
open_port = OpenClosePort(OpenClosePort=toggle, PortNumber=ports_available, BaudRate=115200)
panel_2 = Panel(open_port)
panel_3 = Panel(read.SerialOutput)
panel_4 = Panel(uno_read.AnalogPin0)
panel_5 = Panel(uno_read.StatusMessage)

panel_6 = Panel(uno_read.AnalogPin1)
panel_7 = Panel(uno_read.AnalogPin2)
panel_8 = Panel(uno_read.AnalogPin3)

split = TextSplit(Text=panel_3, Separators="-")
item = ListItem(List=split, Index="0", Wrap=True)
item_2 = ListItem(List=split, Index="1", Wrap=True)
item_3 = ListItem(List=split, Index="2", Wrap=True)
item_4 = ListItem(List=split, Index="4", Wrap=True)

int = Integer(item)
int_2 = Integer(item_2)
int_3 = Integer(item_3)
int_4 = Integer(item_4)
int_5 = Integer(int)
int_6 = Integer(int_4)
int_7 = Integer(int_2)
int_8 = Integer(int_3)
num = Number([int_6, int_8, int_5, int_7])
brep = Brep(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)
mesh = Mesh(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)
debrep = DeconstructBrep(Brep=brep)  # -> Faces, Edges, Vertices
wbcatmullclark = WeaverbirdsCatmullClarkSubdivision(MeshCurves=mesh, Level=Slider(1, range=0..10), SmoothNakedEdges=1)
wbwindow = WeaverbirdsMeshWindow(MeshPolylines=wbcatmullclark, Distance=5, InsetType=0)
explode = MeshExplode(Mesh=wbwindow, Interpolate=False)

item_5 = ListItem(List=debrep.Faces, Index=Slider(33, range=0..56), Wrap=True)
item_6 = ListItem(List=debrep.Faces, Index=Slider(0, range=0..56), Wrap=True)
item_7 = ListItem(List=debrep.Faces, Index=Slider(46, range=0..56), Wrap=True)
item_8 = ListItem(List=debrep.Faces, Index=Slider(16, range=0..56), Wrap=True)

lng = ListLength(List=explode)
division = Division(A=lng, B=Slider(1.5, range=0..10))
random = Random(Range=lng, Number=division, Seed=Slider(58, range=0..100))
int_9 = Integer(random)
area = Area(Geometry=item_5)  # -> Area, Centroid
area_2 = Area(Geometry=item_6)  # -> Area, Centroid
area_3 = Area(Geometry=item_7)  # -> Area, Centroid
area_4 = Area(Geometry=item_8)  # -> Area, Centroid
sort_val = SortDuplicateValues(ValueList=int_9)  # -> UniqueValues, Indices
item_9 = ListItem(List=explode, Index=sort_val.UniqueValues, Wrap=True)
pt = Point([area.Centroid, area_2.Centroid, area_3.Centroid, area_4.Centroid])
area_5 = Area(Geometry=item_9)  # -> Area, Centroid
cp = ClosestPoint(Point=area_5.Centroid, Cloud=pt)  # -> ClosestPoint, CPIndex, Distance
item_10 = ListItem(List=num, Index=cp.CPIndex, Wrap=True)
subtraction = Subtraction(A=Slider(11, range=0..100), B=cp.Distance)
division_2 = Division(A=subtraction, B=Slider(4, range=0..100))
multiplication = Multiplication(A=division_2, B=item_10)
bnd = Bounds(Numbers=multiplication)
dedomain = DeconstructDomain(Domain=bnd)  # -> Start, End
dom = ConstructDomain(DomainStart=Slider(0.2, range=0..1), DomainEnd=Slider(0.9, range=0..1))
gradient = Gradient(
    LowerLimit=dedomain.End,
    UpperLimit=dedomain.Start,
    Parameter=multiplication,
    stops=[0: RGB(234, 38, 0), 0.25: RGB(234, 126, 0), 0.5: RGB(254, 244, 84), 0.75: RGB(173, 203, 249), 1: RGB(75, 107, 169)])
remap = RemapNumbers(Value=multiplication, Source=bnd, Target=dom)  # -> Mapped, Clipped
scale = Scale(Geometry=item_9, Center=area_5.Centroid, Factor=remap.Mapped)  # -> Geometry, Transform
medges = MeshEdges(Mesh=scale.Geometry)  # -> NakedEdges, InteriorEdges, NonManifoldEdges
medges_2 = MeshEdges(Mesh=item_9)  # -> NakedEdges, InteriorEdges, NonManifoldEdges
join = JoinCurves(Curves=medges.NakedEdges, Preserve=False)
wbframe = WeaverbirdsPictureFrame(MeshPolylines=wbcatmullclark, Distance=5, InsetType=0)
reb = RebuildCurve(Curve=join, Degree=3, Count=6, Tangents=False)  # -> simplify(Curve)
join_2 = JoinCurves(Curves=medges_2.NakedEdges, Preserve=False)  # -> simplify(Curves)
wbthicken = WeaverbirdsMeshThicken(MeshCurves=wbframe, Distance=Slider(0.2, range=0..1), OffsetType=0)
graft = GraftTree(Tree=reb, IncludeEmptyLists=True, IncludeNullItems=True)
graft_2 = GraftTree(Tree=join_2, IncludeEmptyLists=True, IncludeNullItems=True)
colour = ColourPicker(PickedColour=RGB(204, 204, 204))
merge = Merge(Data1=graft(graft), Data2=graft(graft_2))
gradient_2 = Gradient(
    LowerLimit=0,
    UpperLimit=1,
    Parameter=Slider(0.9, range=0..1),
    stops=[0: RGB(234, 38, 0), 0.25: RGB(234, 126, 0), 0.5: RGB(254, 244, 84), 0.75: RGB(173, 203, 249), 1: RGB(75, 107, 169)])
mesh_2 = Mesh(wbthicken)
cull_i = CullIndex(List=explode, Indices=sort_val.UniqueValues, Wrap=True)
loft = Loft(Curves=merge, Options={Adjust=False, Closed=False, LoftEnds=0, LoftSimp=0, LoftType=0, Rebuild=10, Refit=0.01})
mesh_3 = Mesh(cull_i)

preview = CustomPreview(Geometry=flatten(loft), Shader=flatten(gradient))
preview_2 = CustomPreview(Geometry=flatten(mesh_3), Shader=flatten(gradient_2))
preview_3 = CustomPreview(Geometry=flatten(mesh_2), Shader=flatten(colour))
